# Grasshopper definition truss_opt_num_bays.gh (Grasshopper 1.0.7)
# plug-ins: Discover, karambaGH

sequence = Sequence(Name="Input", Number=4, Input_id="kX93H5bk")  # -> Status, Values
number_of_bays = Slider(20, range=0..30)
discover = Discover(Connect=Button())  # -> Status, Message
screenshot = CaptureScreenshot(ViewName="Right", Message=discover.Message)
length = Slider(20, range=0..20)
number_slider = Slider(3, range=0..20)
categorical = Categorical(Name="Number of bays", Number=number_of_bays, Count="1", Message=discover.Message, Input_id="FzP2rhHw")  # -> Status, Values
categorical_2 = Categorical(Name="Input", Number="91", Count="1", Message=discover.Message, Input_id="M57TgQaP")  # -> Status, Values
addition = Addition(A=categorical.Values, B="1")
crosecrselect = CrossSectionRangeSelectorKaramba3D(MaximumHeight_cm=-1, MaximumWidth_cm=-1, menu=[dropdown(2), dropdown(1), dropdown(1)])
panel = Panel([categorical.Values, categorical_2.Values])
num = Number(addition)
neg = Negative(Value=Slider(800, range=0..2000))
division = Division(A=length, B=num)
Z = UnitZ(Factor=1)
subtraction = Subtraction(A=num, B="1")
addition_2 = Addition(A=num, B="1")
python = GhPythonScript(x=crosecrselect, y=categorical_2.Values)  # -> section, length_x; inputs x: list
# ---------- python: Python ----------
__author__ = "Sean Yu"
__version__ = "2021.01.09"

import rhinoscriptsyntax as rs
#out=x[0]
length_x=len(x)
section=x[int(y)]
print(section)
# ---------- end python ----------
division_2 = Division(A=neg, B=addition_2)
panel_2 = Panel(python.length_x)
panel_3 = Panel(python.section)
multiplication = Multiplication(A=Z, B=division_2)
pt = PointOriented(BasePlane="0,0", UComponent=0, VComponent=0, WComponent=0)
pt_2 = PointOriented(BasePlane="0,0", UComponent=0, VComponent=division, WComponent=0)
pt_3 = PointOriented(BasePlane="0,0", UComponent=0, VComponent=0, WComponent=number_slider)
pt_4 = PointOriented(BasePlane="0,0", UComponent=0, VComponent=division, WComponent=number_slider)
pt_5 = PointOriented(BasePlane="0,0", UComponent=0, VComponent=length, WComponent=0)
pt_6 = PointOriented(BasePlane="0,0", UComponent=0, VComponent=length, WComponent=number_slider)
matselect = MaterialSelectionKaramba3D(menu=[dropdown(1), dropdown(4)])
cross_section = CrossSectionKaramba3D(
    FamilyNameOfCrossSection="DefaultCroSec",
    NameOfCrossSection=python.section,
    Material=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,
    Height_cm=9.6,
    UpperFlangeWidth_cm=10,
    LowerFlangeWidth_cm=10,
    UpperFlangeThickness_cm=0.8,
    LowerFlangeThickness_cm=0.8,
    WebThickness_cm=0.5,
    FilletRadius_cm=0,
    mode="I")
vec = VectorXYZ(XComponent="0", YComponent=division, ZComponent="0")  # -> Vector, Length
vec_2 = VectorXYZ(XComponent="0", YComponent=division, ZComponent=number_slider)  # -> Vector, Length
ln = Line(StartPoint=pt, EndPoint=pt_2)
ln_2 = Line(StartPoint=pt_2, EndPoint=pt_4)
ln_3 = Line(StartPoint=pt_3, EndPoint=pt)
ln_4 = Line(StartPoint=pt_3, EndPoint=pt_4)
ln_5 = Line(StartPoint=pt_3, EndPoint=pt_2)
ln_6 = Line(StartPoint=pt, EndPoint=pt_4)
arrlinear = LinearArray(Geometry=vec_2.Vector, Direction=vec.Vector, Count=subtraction)  # -> flatten(Geometry), Transform
arrlinear_2 = LinearArray(Geometry=pt_2, Direction=vec.Vector, Count=subtraction)  # -> flatten(Geometry), Transform
arrlinear_3 = LinearArray(Geometry=ln_4, Direction=vec.Vector, Count=num)  # -> flatten(Geometry), Transform
arrlinear_4 = LinearArray(Geometry=ln_2, Direction=vec.Vector, Count=num)  # -> flatten(Geometry), Transform
arrlinear_5 = LinearArray(Geometry=[ln_6, ln_5], Direction=vec.Vector, Count=num)  # -> flatten(Geometry), Transform
arrlinear_6 = LinearArray(Geometry=ln, Direction=vec.Vector, Count=num)  # -> flatten(Geometry), Transform
loads = LoadsKaramba3D(ForceVector=multiplication, Local=False, PosInd=[arrlinear.Geometry, pt_3, pt_6], LCase=0, mode="Point")
crv = Curve([arrlinear_4.Geometry, ln_3])
supp = SupportKaramba3D(PosInd=pt, menu=[buttons(on, on, on, off, on, off)])
supp_2 = SupportKaramba3D(PosInd=pt_5, menu=[buttons(on, off, on, off, on, off)])
panel_4 = Panel(loads)
pt_7 = Point([pt, pt_3, arrlinear.Geometry, pt_5, pt_6, arrlinear_2.Geometry])
linetobeam = LineToBeamKaramba3D(Line=crv, New=True, Remove=True, LimitDistance_m=0.005)  # -> Element, Points, Info
linetobeam_2 = LineToBeamKaramba3D(Line=arrlinear_6.Geometry, New=True, Remove=True, LimitDistance_m=0.005, Bending="0")  # -> Element, Points, Info
linetobeam_3 = LineToBeamKaramba3D(Line=arrlinear_3.Geometry, Identifier="Top Chord", New=True, Remove=True, LimitDistance_m=0.005)  # -> Element, Points, Info
linetobeam_4 = LineToBeamKaramba3D(Line=arrlinear_5.Geometry, New=True, Remove=True, LimitDistance_m=0.005, Bending="0")  # -> Element, Points, Info
assemble = AssembleModelKaramba3D(
    Point=pt_7,
    Elem=[linetobeam.Element, linetobeam_3.Element, linetobeam_2.Element, linetobeam_4.Element],
    Support=[supp_2, supp],
    Load=loads,
    CrossSection=cross_section,
    Material=matselect,
    LimitDistance_m=0.005)  # -> Model, Info, Mass_kg, CenterOfGravity
analyze = AnalyzeKaramba3D(Model=assemble.Model)  # -> CalculatedModel, MaximumDisplacement_cm, ResultingForceOfGravity_kN, ElasticEnergy_kNm
objective = Objective(Name="Mass", Value=assemble.Mass_kg, Goal="Minimize")
panel_5 = Panel(assemble.Mass_kg)
modelview = ModelViewKaramba3D(Model=analyze.CalculatedModel, ResultFactors=1, ResultCase=-1)  # -> Model, DeformedMesh, DeformedAxes, DeformedModel
beamview = BeamViewKaramba3D(Model=modelview.Model)  # -> Model, MeshesOfRenderedBeams, DeformedBeamAxes, LegendColors, LegendTags
panel_6 = Panel(beamview.LegendTags)
nodedisp = NodalDisplacementsKaramba3D(AnalyzedModel=beamview.Model, ResultCase=0)  # -> AnalyzedModel, NodalTranslations_m, NodalRotations_rad
panel_7 = Panel(length)
division_3 = Division(A=panel_7, B=Slider(500, range=400..600))
python_2 = GhPythonScript(x=panel_6)  # -> max_util; inputs x: list
# ---------- python_2: Python ----------
__author__ = "Sean Yu"
__version__ = "2021.01.09"

import rhinoscriptsyntax as rs
util=[]

for i in x[1:]:
    a=(i.strip('%'))
    b=map(float, i.strip('%').split())
    util.append(b)

util=[item for sublist in util for item in sublist] 
util=[abs(x) for x in util]

max_util=max(util)
print(max_util)
# ---------- end python_2 ----------
python_3 = GhPythonScript(x=nodedisp.NodalTranslations_m, targ_disp=division_3)  # -> min_targ_disp, max_disp; inputs x: list
# ---------- python_3: Python ----------
__author__ = "Sean Yu"
__version__ = "2021.01.09"

import rhinoscriptsyntax as rs
z_disp=[]
for i in x:
    z_disp.append(i[2])
max_disp=min(z_disp)
min_targ_disp=abs(abs(targ_disp)-abs(max_disp))
# ---------- end python_3 ----------
constraint = Constraint(Name="Utilization", Target="100", Value=python_2, Goal="Less than", Output_id="lqgdBgO8")
objective_2 = Objective(Name="Target Displacement", Value=python_3.min_targ_disp, Goal="Minimize")
panel_8 = Panel(python_3.min_targ_disp)
