# Grasshopper definition truss_opt_web_config.gh (Grasshopper 1.0.7)
# plug-ins: Discover, karambaGH

discover = Discover(Connect=Button())  # -> Status, Message
number_of_nodes = Slider(10, range=0..20)
number_slider = Slider(6, range=0..20)
length = Slider(20, range=0..20)
screenshot = CaptureScreenshot(ViewName="Right", Message=discover.Message)
categorical = Categorical(Name="Number of Segments", Number="20", Count="1", Input_id="7XbaaTaF")  # -> Status, Values
categorical_2 = Categorical(Name="Input", Number="90", Count="1", Input_id="M57TgQaP")  # -> Status, Values
addition = Addition(A=categorical.Values, B="1")
multiplication = Multiplication(A=number_of_nodes, B="3")
categorical_3 = Categorical(Name="Truss Interior", Number="2", Count=multiplication, Message=discover.Message, Input_id="FzP2rhHw")  # -> Status, Values
python = GhPythonScript(x=categorical_3.Values)  # -> out; inputs x: list
# ---------- python: Python ----------
__author__ = "Sean Yu"
__version__ = "2021.01.09"

import rhinoscriptsyntax as rs
x=x[:-1]
x=[str(int(item)) for item in x]
out=''.join(map(str,x))
print(out)
# ---------- end python ----------
num = Number(number_of_nodes)
crosecrselect = CrossSectionRangeSelectorKaramba3D(MaximumHeight_cm=-1, MaximumWidth_cm=-1, menu=[dropdown(2), dropdown(1), dropdown(1)])
panel = Panel(addition)
neg = Negative(Value=Slider(100, range=0..100000))
subtraction = Subtraction(A=num, B="1")
division = Division(A=length, B=num)
panel_2 = Panel(python)
Z = UnitZ(Factor=1)
addition_2 = Addition(A=num, B="1")
python_2 = GhPythonScript(x=crosecrselect, y="90")  # -> section, length_x; inputs x: list
# ---------- python_2: Python ----------
__author__ = "Sean Yu"
__version__ = "2021.01.09"

import rhinoscriptsyntax as rs
#out=x[0]
length_x=len(x)
section=x[int(y)]
print(section)
# ---------- end python_2 ----------
division_2 = Division(A=neg, B=addition_2)
panel_3 = Panel(python_2.length_x)
multiplication_2 = Multiplication(A=Z, B=division_2)
pt = PointOriented(BasePlane="0,0", UComponent=0, VComponent=0, WComponent=0)
pt_2 = PointOriented(BasePlane="0,0", UComponent=0, VComponent=division, WComponent=0)
pt_3 = PointOriented(BasePlane="0,0", UComponent=0, VComponent=0, WComponent=number_slider)
pt_4 = PointOriented(BasePlane="0,0", UComponent=0, VComponent=division, WComponent=number_slider)
pt_5 = PointOriented(BasePlane="0,0", UComponent=0, VComponent=length, WComponent=0)
pt_6 = PointOriented(BasePlane="0,0", UComponent=0, VComponent=length, WComponent=number_slider)
cross_section = CrossSectionKaramba3D(
    FamilyNameOfCrossSection="DefaultCroSec",
    NameOfCrossSection=python_2.section,
    Material=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,
    Height_cm=9.6,
    UpperFlangeWidth_cm=10,
    LowerFlangeWidth_cm=10,
    UpperFlangeThickness_cm=0.8,
    LowerFlangeThickness_cm=0.8,
    WebThickness_cm=0.5,
    FilletRadius_cm=0,
    mode="I")
matselect = MaterialSelectionKaramba3D(menu=[dropdown(1), dropdown(4)])
vec = VectorXYZ(XComponent="0", YComponent=division, ZComponent="0")  # -> Vector, Length
vec_2 = VectorXYZ(XComponent="0", YComponent=division, ZComponent=number_slider)  # -> Vector, Length
ln = Line(StartPoint=pt_5, EndPoint=pt_6)
ln_2 = Line(StartPoint=pt, EndPoint=pt_2)
ln_3 = Line(StartPoint=pt_3, EndPoint=pt_4)
panel_4 = Panel(cross_section)
python_3 = GhPythonScript(x=python)  # -> out
# ---------- python_3: Python ----------
__author__ = "Sean Yu"
__version__ = "2021.01.09"

import rhinoscriptsyntax as rs
if float(x)==0.0 or len(x)==0:
    out=0
else:
    out=int(x)

print(out)
# ---------- end python_3 ----------
constraint = Constraint(Name="Number of Interior", Target="0", Value=python_3, Goal="Greater than", Output_id="ZSbSZ1kM")
panel_5 = Panel(python_3)
arrlinear = LinearArray(Geometry=ln_3, Direction=vec.Vector, Count=num)  # -> flatten(Geometry), Transform
arrlinear_2 = LinearArray(Geometry=pt_2, Direction=vec.Vector, Count=subtraction)  # -> flatten(Geometry), Transform
pt_7 = Point([arrlinear_2.Geometry, pt_5, pt])
arrlinear_3 = LinearArray(Geometry=vec_2.Vector, Direction=vec.Vector, Count=subtraction)  # -> flatten(Geometry), Transform
pt_8 = Point([arrlinear_3.Geometry, pt_6, pt_3])
loads = LoadsKaramba3D(ForceVector=multiplication_2, Local=False, PosInd=[arrlinear_3.Geometry, pt_6], LCase=0, mode="Point")
python_4 = GhPythonScript(input=python, x=pt_8, y=pt_7)  # -> out, flatten(lines); inputs x: list, y: list
# ---------- python_4: Python ----------
__author__ = "Sean Yu"
__version__ = "2021.01.09"

import rhinoscriptsyntax as rs

top_points=x
bot_points=y
top_points=[rs.coerce3dpoint(x) for x in top_points]
bot_points=[rs.coerce3dpoint(x) for x in bot_points]
#print(top_points)
top_points=rs.SortPoints(top_points,1,0)
bot_points=rs.SortPoints(bot_points,1,0)
test_var=str('000000010000011')
var=input
#print(test_var[14])
#print(range(len(var)))
lines=[]
for i in range(len(var)):
    #print(i)
    #print(int(var[i]))
    if int(var[i])==1:
        block=i//3
        remainder=i%3
        #print(remainder)
        if remainder==0:
            lines.append(rs.AddLine(top_points[block+1],bot_points[block+1]))
            print(i,'added line')
        if remainder==1:
            lines.append(rs.AddLine(top_points[block],bot_points[block+1]))
            print(i,'added line')
        else:
            #print(block)
            #print(rs.coerce3dpoint(top_points[block+1]))
            lines.append(rs.AddLine(top_points[block+1],bot_points[block]))
            print(remainder,i,'added line')
lines
# ---------- end python_4 ----------
arrlinear_4 = LinearArray(Geometry=ln_2, Direction=vec.Vector, Count=num)  # -> flatten(Geometry), Transform
panel_6 = Panel(loads)
supp = SupportKaramba3D(PosInd=pt_3, menu=[buttons(on, on, off, off, off, on)])
supp_2 = SupportKaramba3D(PosInd=pt, menu=[buttons(on, on, on, off, off, on)])
pt_9 = Point([pt, pt_3, arrlinear_3.Geometry, pt_5, pt_6, arrlinear_2.Geometry])
linetobeam = LineToBeamKaramba3D(Line=[arrlinear_4.Geometry, ln], New=True, Remove=True, LimitDistance_m=0.005)  # -> Element, Points, Info
linetobeam_2 = LineToBeamKaramba3D(Line=python_4.lines, New=True, Remove=True, LimitDistance_m=0.005, Bending="0")  # -> Element, Points, Info
linetobeam_3 = LineToBeamKaramba3D(Line=arrlinear.Geometry, Identifier="Top Chord", New=True, Remove=True, LimitDistance_m=0.005)  # -> Element, Points, Info
assemble = AssembleModelKaramba3D(
    Point=pt_9,
    Elem=[linetobeam_3.Element, linetobeam.Element, linetobeam_2.Element],
    Support=[supp, supp_2],
    Load=loads,
    CrossSection=cross_section,
    Material=matselect,
    LimitDistance_m=0.005)  # -> Model, Info, Mass_kg, CenterOfGravity
objective = Objective(Name="Mass", Value=assemble.Mass_kg, Goal="Minimize")
analyze = AnalyzeKaramba3D(Model=assemble.Model)  # -> CalculatedModel, MaximumDisplacement_cm, ResultingForceOfGravity_kN, ElasticEnergy_kNm
panel_7 = Panel(assemble.Mass_kg)
modelview = ModelViewKaramba3D(Model=analyze.CalculatedModel, ResultFactors=1, ResultCase=-1)  # -> Model, DeformedMesh, DeformedAxes, DeformedModel
beamview = BeamViewKaramba3D(Model=modelview.Model)  # -> Model, MeshesOfRenderedBeams, DeformedBeamAxes, LegendColors, LegendTags
panel_8 = Panel(beamview.LegendTags)
nodedisp = NodalDisplacementsKaramba3D(AnalyzedModel=beamview.Model, ResultCase=0)  # -> AnalyzedModel, NodalTranslations_m, NodalRotations_rad
panel_9 = Panel(length)
division_3 = Division(A=panel_9, B=Slider(500, range=400..600))
python_5 = GhPythonScript(x=panel_8)  # -> max_util; inputs x: list
# ---------- python_5: Python ----------
__author__ = "Sean Yu"
__version__ = "2021.01.09"

import rhinoscriptsyntax as rs
util=[]

for i in x[1:]:
    a=(i.strip('%'))
    b=map(float, i.strip('%').split())
    util.append(b)

util=[item for sublist in util for item in sublist] 
util=[abs(x) for x in util]

max_util=max(util)
print(max_util)
# ---------- end python_5 ----------
python_6 = GhPythonScript(x=nodedisp.NodalTranslations_m, targ_disp=division_3)  # -> min_targ_disp, max_disp; inputs x: list
# ---------- python_6: Python ----------
__author__ = "Sean Yu"
__version__ = "2021.01.09"

import rhinoscriptsyntax as rs
z_disp=[]
for i in x:
    z_disp.append(i[2])
max_disp=min(z_disp)
min_targ_disp=abs(abs(targ_disp)-abs(max_disp))
# ---------- end python_6 ----------
panel_10 = Panel(python_5)
constraint_2 = Constraint(Name="Utilization", Target="100", Value=python_5, Goal="Less than", Output_id="lqgdBgO8")
objective_2 = Objective(Name="Target Displacement", Value=python_6.min_targ_disp, Goal="Minimize")
panel_11 = Panel(python_6.min_targ_disp)
